# Grasshopper definition test.gh (Grasshopper 1.0.7)
# plug-ins: EditableGeometry

crv = Curve(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)
sph = Sphere(Base=PlaneXY(0, 0, 0), Radius=Slider(25, range=0..100))
X = UnitX(Factor=Slider(100, range=0..100))
move = Move(Geometry=crv, Motion=X)  # -> Geometry, Transform
edit = Edit(Geometry=move.Geometry, Flush=Button(), EditMode=False)
